# Grasshopper definition Facade_PopulateBlockModule_001.gh (Grasshopper 1.0.7)
# plug-ins: eleFront

panel = Panel("""acation@cca.edu

Description""")

# ---- group: Input Profile
crv = Curve(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)

# ---- group: Input Block
extgeo = ExtendedGeometry()

# ---- group: Subdivision Distance
num = Number(Slider(5, range=0..10))

# ---- group: Floor To Floor
num_2 = Number(Slider(12, range=0..20))

# ---- group: Number of Floors
num_3 = Number(Slider(6, range=0..100))

# ----
block_info = GetBlockInfo(Block=extgeo)  # -> Name, Plane, Transform, BlockType, FilePath, Active
pln = Plane(block_info.Plane)
fillet = Fillet(Curve=crv, Radius=Slider(40, range=0..100))
crv_2 = Curve(fillet)

# ---- group: Divide Crv
explode = Explode(Curve=crv_2, Recursive=True)  # -> Segments, Vertices
divdist = DivideDistance(Curve=explode.Segments, Distance=num)  # -> Points, Tangents, Parameters
end = EndPoints(Curve=graft(explode.Segments))  # -> Start, End
lng = ListLength(List=divdist.Points)
item = ListItem(List=divdist.Points, Index=0, Wrap=True)  # -> Item1, Item
pt = Point(item.Item1)
dist = Distance(PointA=pt, PointB=end.End)
python = GhPythonScript(x=lng, y=dist, z=num)  # -> out, a
# ---------- python: Python ----------
if y < z/2:
    a = x-1
else:
    a = x
# ---------- end python ----------
divide = DivideCurve(Curve=graft(explode.Segments), Count=python.a, Kinks=False)  # -> Points, Tangents, Parameters

# ----
pt_2 = Point(divide.Points)
vec = Vector(divide.Tangents)

pline = PolyLine(Vertices=pt_2, Closed=False)
cull_i = CullIndex(List=pt_2, Indices="-1", Wrap=True)
cull_i_2 = CullIndex(List=vec, Indices="-1", Wrap=True)
line = LineSDL(Start=cull_i, Direction=Vector(0, 0, 1), Length=1)
explode_2 = Explode(Curve=pline, Recursive=True)  # -> Segments, Vertices
end_2 = EndPoints(Curve=explode_2.Segments)  # -> Start, End
vrot = Rotate(Vector=cull_i_2, Axis=line, Angle=degrees("90"))
vec2pt = Vector2Pt(PointA=end_2.Start, PointB=end_2.End, Unitize=False)  # -> Vector, Length
pl = ConstructPlane(Origin=cull_i, XAxis=vec2pt.Vector, YAxis=vrot)
len = Length(Curve=explode_2.Segments)

# ---- group: Input Block
extgeo_2 = ExtendedGeometry(extgeo)

# ----
pln_2 = Plane(pln)

bbox = BoundingBox(Content=extgeo_2, Plane=PlaneXY(0, 0, 0))  # -> Box, Box_2
debox = DeconstructBox(Box=bbox.Box)  # -> Plane, X, Y, Z
dedomain = DeconstructDomain(Domain=debox.X)  # -> Start, End
dedomain_2 = DeconstructDomain(Domain=debox.Z)  # -> Start, End
subtraction = Subtraction(A=dedomain.End, B=dedomain.Start)
subtraction_2 = Subtraction(A=dedomain_2.End, B=dedomain_2.Start)

orient = Orient(Geometry=extgeo_2, Source=pln_2, Target=pl)  # -> Geometry, Transform
division = Division(A=len, B=subtraction)
division_2 = Division(A=num_2, B=subtraction_2)
scale_nu = ScaleNU(Geometry=orient.Geometry, Plane=pl, ScaleX=division, ScaleY=1, ScaleZ=division_2)  # -> Geometry, Transform

series = Series(Start=0, Step=num_2, Count=num_3)
Z = UnitZ(Factor=series)
move = Move(Geometry=graft(scale_nu.Geometry), Motion=Z)  # -> Geometry, Transform

bake = BakeObjects(Geometry=move.Geometry, BakeName="Block Facade", Bake=Toggle(True), createGroups=False)  # -> Message, Guids
